# Grasshopper definition interface.gh (Grasshopper 1.0.7)
# plug-ins: Human UI

create_button = CreateButton(ButtonName="更新", ButtonStyle=0)
create_button_2 = CreateButton(ButtonName="生成", ButtonStyle=0)
value_listener = ValueListener(Elements=create_button_2, SomeProperty=True)  # -> Values, Indices
merge = Merge(Data1=create_button_2, Data2=create_button)
adjust_element_positioning = AdjustElementPositioning(
    ElementsToAdjust=[create_button, create_button_2],
    AbsolutePositioning=False,
    Width=Slider(100, range=0..100),
    Height=Slider(50, range=0..100))
create_stack = CreateStack(UIElements=merge, Horizontal=Toggle(True))

迭代次数 = Slider(1000, range=0..1000)
create_slider = CreateSlider(Slider=迭代次数, ShowBounds=False, ShowTicks=False, ShowTooltip=False, ShowValLabel=True, showLabel=True)
value_listener_2 = ValueListener(Elements=create_slider, SomeProperty=True)  # -> Values, Indices
merge_2 = Merge(Data1=create_slider, Data2=create_stack)
create_stack_2 = CreateStack(UIElements=merge_2, Horizontal=Toggle(False))

驱动盘y位置 = Slider(25, range=10..40)
驱动盘x位置 = Slider(25, range=10..40)
驱动盘半径 = Slider(25, range=10..40)
骨骼宽度 = Slider(40, range=30..60)
create_slider_2 = CreateSlider(Slider=驱动盘x位置, ShowBounds=False, ShowTicks=False, ShowTooltip=False, ShowValLabel=True, showLabel=True)
create_slider_3 = CreateSlider(Slider=驱动盘y位置, ShowBounds=False, ShowTicks=False, ShowTooltip=False, ShowValLabel=True, showLabel=True)
弹簧螺数 = Slider(3, range=2..5)
merge_3 = Merge(Data1=create_slider_2, Data2=create_slider_3)
create_text_block = CreateTextBlock(Text="驱动器", TextSize=12, Justification=0)
create_slider_4 = CreateSlider(Slider=驱动盘半径, ShowBounds=False, ShowTicks=False, ShowTooltip=False, ShowValLabel=True, showLabel=True)
create_slider_5 = CreateSlider(Slider=骨骼宽度, ShowBounds=False, ShowTicks=False, ShowTooltip=False, ShowValLabel=True, showLabel=True)
create_slider_6 = CreateSlider(Slider=弹簧螺数, ShowBounds=False, ShowTicks=False, ShowTooltip=False, ShowValLabel=True, showLabel=True)
create_text_block_2 = CreateTextBlock(Text="骨骼和弹簧", TextSize=12, Justification=0)
create_stack_3 = CreateStack(UIElements=merge_3, Horizontal=True)
value_listener_3 = ValueListener(Elements=create_slider_4, SomeProperty=True)  # -> Values, Indices
value_listener_4 = ValueListener(Elements=create_slider_2, SomeProperty=True)  # -> Values, Indices
value_listener_5 = ValueListener(Elements=create_slider_6, SomeProperty=True)  # -> Values, Indices
value_listener_6 = ValueListener(Elements=create_slider_3, SomeProperty=True)  # -> Values, Indices
value_listener_7 = ValueListener(Elements=create_slider_5, SomeProperty=True)  # -> Values, Indices
merge_4 = Merge(
    Data1=create_text_block,
    Data2=create_slider_4,
    Data3=create_stack_3,
    Data5=create_text_block_2,
    Data6=create_slider_5,
    Data7=create_slider_6)
merge_5 = Merge(
    Data1=value_listener_3.Values,
    Data2=value_listener_4.Values,
    Data3=value_listener_6.Values,
    Data4=value_listener_7.Values,
    Data5=value_listener_5.Values)

merge_6 = Merge(Data1="跖行动物(人)", Data2="趾行动物(狗)", Data3="蹄行动物(牛)")
create_pulldown_menu = CreatePulldownMenu(Label="行走类型", ListItems=merge_6, showLabel=True)

merge_7 = Merge(Data1="约30cm", Data2="约50cm", Data3="约1m")
create_pulldown_menu_2 = CreatePulldownMenu(Label="身长/身高", ListItems=merge_7, showLabel=True)

merge_8 = Merge(Data1="单侧肌肉驱动", Data2="弯曲肌驱动", Data3="伸直肌驱动")
create_pulldown_menu_3 = CreatePulldownMenu(Label="驱动方式", ListItems=merge_8, showLabel=True)

小腿 = Slider(90, range=10..150)
跖 = Slider(90, range=10..150)
大腿 = Slider(90, range=10..150)
跖_2 = Slider(30, range=0..100)
趾 = Slider(20, range=0..100)
小腿_2 = Slider(50, range=0..100)
趾_2 = Slider(90, range=10..150)
大腿_2 = Slider(50, range=0..100)
create_text_block_3 = CreateTextBlock(Text="骨骼长度", TextSize=12, Justification=0)
create_slider_7 = CreateSlider(Slider=大腿_2, ShowBounds=False, ShowTicks=False, ShowTooltip=False, ShowValLabel=True, showLabel=True)
create_text_block_4 = CreateTextBlock(Text="最大弯曲角度", TextSize=12, Justification=0)
create_slider_8 = CreateSlider(Slider=小腿_2, ShowBounds=False, ShowTicks=False, ShowTooltip=False, ShowValLabel=True, showLabel=True)
create_slider_9 = CreateSlider(Slider=跖_2, ShowBounds=False, ShowTicks=False, ShowTooltip=False, ShowValLabel=True, showLabel=True)
create_slider_10 = CreateSlider(Slider=趾, ShowBounds=False, ShowTicks=False, ShowTooltip=False, ShowValLabel=True, showLabel=True)
create_slider_11 = CreateSlider(Slider=大腿, ShowBounds=False, ShowTicks=False, ShowTooltip=False, ShowValLabel=True, showLabel=True)
create_slider_12 = CreateSlider(Slider=小腿, ShowBounds=False, ShowTicks=False, ShowTooltip=False, ShowValLabel=True, showLabel=True)
create_slider_13 = CreateSlider(Slider=跖, ShowBounds=False, ShowTicks=False, ShowTooltip=False, ShowValLabel=True, showLabel=True)
create_slider_14 = CreateSlider(Slider=趾_2, ShowBounds=False, ShowTicks=False, ShowTooltip=False, ShowValLabel=True, showLabel=True)
merge_9 = Merge(Data1=create_text_block_3, Data2=create_slider_7, Data3=create_slider_8, Data4=create_slider_9, Data5=create_slider_10)
merge_10 = Merge(
    Data1=create_text_block_4,
    Data2=create_slider_11,
    Data3=create_slider_12,
    Data4=create_slider_13,
    Data5=create_slider_14)
大腿_3 = Slider(0, range=-20..20)
小腿_3 = Slider(0, range=-20..20)
趾_3 = Slider(0, range=-20..20)
跖_3 = Slider(0, range=-20..20)
create_text_block_5 = CreateTextBlock(Text="最大反向弯曲角度", TextSize=12, Justification=0)
create_slider_15 = CreateSlider(Slider=大腿_3, ShowBounds=False, ShowTicks=False, ShowTooltip=False, ShowValLabel=True, showLabel=True)
create_slider_16 = CreateSlider(Slider=小腿_3, ShowBounds=False, ShowTicks=False, ShowTooltip=False, ShowValLabel=True, showLabel=True)
create_slider_17 = CreateSlider(Slider=跖_3, ShowBounds=False, ShowTicks=False, ShowTooltip=False, ShowValLabel=True, showLabel=True)
create_slider_18 = CreateSlider(Slider=趾_3, ShowBounds=False, ShowTicks=False, ShowTooltip=False, ShowValLabel=True, showLabel=True)
merge_11 = Merge(
    Data1=create_text_block_5,
    Data2=create_slider_15,
    Data3=create_slider_16,
    Data4=create_slider_17,
    Data5=create_slider_18)
merge_12 = Merge(Data1=merge_9, Data2=merge_10, Data3=merge_11)

小腿_4 = Slider(90, range=10..150)
跖_4 = Slider(90, range=10..150)
大腿_4 = Slider(90, range=10..150)
跖_5 = Slider(30, range=0..100)
趾_4 = Slider(20, range=0..100)
小腿_5 = Slider(50, range=0..100)
趾_5 = Slider(90, range=10..150)
大腿_5 = Slider(50, range=0..100)
create_text_block_6 = CreateTextBlock(Text="骨骼长度", TextSize=12, Justification=0)
create_slider_19 = CreateSlider(Slider=大腿_5, ShowBounds=False, ShowTicks=False, ShowTooltip=False, ShowValLabel=True, showLabel=True)
create_text_block_7 = CreateTextBlock(Text="最大弯曲角度", TextSize=12, Justification=0)
create_slider_20 = CreateSlider(Slider=小腿_5, ShowBounds=False, ShowTicks=False, ShowTooltip=False, ShowValLabel=True, showLabel=True)
create_slider_21 = CreateSlider(Slider=跖_5, ShowBounds=False, ShowTicks=False, ShowTooltip=False, ShowValLabel=True, showLabel=True)
create_slider_22 = CreateSlider(Slider=趾_4, ShowBounds=False, ShowTicks=False, ShowTooltip=False, ShowValLabel=True, showLabel=True)
create_slider_23 = CreateSlider(Slider=大腿_4, ShowBounds=False, ShowTicks=False, ShowTooltip=False, ShowValLabel=True, showLabel=True)
create_slider_24 = CreateSlider(Slider=小腿_4, ShowBounds=False, ShowTicks=False, ShowTooltip=False, ShowValLabel=True, showLabel=True)
create_slider_25 = CreateSlider(Slider=跖_4, ShowBounds=False, ShowTicks=False, ShowTooltip=False, ShowValLabel=True, showLabel=True)
create_slider_26 = CreateSlider(Slider=趾_5, ShowBounds=False, ShowTicks=False, ShowTooltip=False, ShowValLabel=True, showLabel=True)
merge_13 = Merge(
    Data1=create_text_block_6,
    Data2=create_slider_19,
    Data3=create_slider_20,
    Data4=create_slider_21,
    Data5=create_slider_22)
merge_14 = Merge(
    Data1=create_text_block_7,
    Data2=create_slider_23,
    Data3=create_slider_24,
    Data4=create_slider_25,
    Data5=create_slider_26)
大腿_6 = Slider(0, range=-20..20)
小腿_6 = Slider(0, range=-20..20)
趾_6 = Slider(0, range=-20..20)
跖_6 = Slider(0, range=-20..20)
create_text_block_8 = CreateTextBlock(Text="最大反向弯曲角度", TextSize=12, Justification=0)
create_slider_27 = CreateSlider(Slider=大腿_6, ShowBounds=False, ShowTicks=False, ShowTooltip=False, ShowValLabel=True, showLabel=True)
create_slider_28 = CreateSlider(Slider=小腿_6, ShowBounds=False, ShowTicks=False, ShowTooltip=False, ShowValLabel=True, showLabel=True)
create_slider_29 = CreateSlider(Slider=跖_6, ShowBounds=False, ShowTicks=False, ShowTooltip=False, ShowValLabel=True, showLabel=True)
create_slider_30 = CreateSlider(Slider=趾_6, ShowBounds=False, ShowTicks=False, ShowTooltip=False, ShowValLabel=True, showLabel=True)
merge_15 = Merge(
    Data1=create_text_block_8,
    Data2=create_slider_27,
    Data3=create_slider_28,
    Data4=create_slider_29,
    Data5=create_slider_30)
merge_16 = Merge(Data1=merge_13, Data2=merge_14, Data3=merge_15)

value_listener_8 = ValueListener(Elements=create_pulldown_menu_2, SomeProperty=True)  # -> Values, Indices
value_listener_9 = ValueListener(Elements=create_pulldown_menu, SomeProperty=True)  # -> Values, Indices
value_listener_10 = ValueListener(Elements=create_pulldown_menu_3, SomeProperty=True)  # -> Values, Indices
merge_17 = Merge(Data1=create_pulldown_menu, Data2=create_pulldown_menu_2, Data3=create_pulldown_menu_3)

width = Slider(570, range=0..2000)
number_slider = Slider(0, range=0..10)
number_slider_2 = Slider(300, range=0..1000)
tabbed_view = TabbedView(TabNames="预设", Tab0=flatten(merge_17))
adjust_element_positioning_2 = AdjustElementPositioning(ElementsToAdjust=tabbed_view, AbsolutePositioning=False, Width=number_slider_2, HorizontalAlignment=number_slider)

tabbed_view_2 = TabbedView(TabNames="生成", Tab0=flatten(create_stack_2))
subtraction = Subtraction(A=width, B=number_slider_2)
adjust_element_positioning_3 = AdjustElementPositioning(
    ElementsToAdjust=tabbed_view_2,
    AbsolutePositioning=False,
    Width=subtraction,
    HorizontalAlignment=Slider(2, range=0..10),
    VerticalAlignment=Slider(2, range=0..100))

number_slider_3 = Slider(762, range=0..2000)
tabbed_view_3 = TabbedView(TabNames=["通用", "前肢", "后肢", "躯干"], Tab0=flatten(merge_4), Tab1=flatten(merge_12), Tab2=flatten(merge_16))
adjust_element_positioning_4 = AdjustElementPositioning(
    ElementsToAdjust=tabbed_view_3,
    Margin="0,0,0,0",
    AbsolutePositioning=False,
    Width=width,
    Height=number_slider_3,
    VerticalAlignment=Slider(2, range=0..10))

merge_18 = Merge(Data1=tabbed_view, Data2=tabbed_view_2)
create_stack_4 = CreateStack(UIElements=merge_18, Horizontal=True)

panel = Panel(value_listener.Values)
panel_2 = Panel("bend limit")
panel_3 = Panel("stretch limit")
# 每种属性按照joints排列成一个数组
# 后肢，前肢，后肢...
merge_19 = Merge(Data1=大腿_5, Data2=大腿_2, Data3=小腿_5, Data4=小腿_2, Data5=跖_5, Data6=跖_2, Data7=趾_4, Data8=趾)
merge_20 = Merge(Data1=大腿_4, Data2=大腿, Data3=小腿_4, Data4=小腿, Data5=跖_4, Data6=跖, Data7=趾_5, Data8=趾_2)
merge_21 = Merge(Data1=大腿_6, Data2=大腿_3, Data3=小腿_6, Data4=小腿_3, Data5=跖_6, Data6=跖_3, Data7=趾_6, Data8=趾_3)

addition = Addition(A=number_slider, B=number_slider_3)
create_stack_5 = CreateStack(UIElements=[create_stack_4, tabbed_view_3], Horizontal=Toggle(False))
colour_picker = ColourPicker(PickedColour=RGB(49, 167, 235))
create_border = CreateBorder(UIElement=create_stack_5, BorderThickness=5, BorderColor=colour_picker, CornerRadius=0)
adjust_element_positioning_5 = AdjustElementPositioning(
    ElementsToAdjust=create_border,
    Margin="0,0,0,0",
    AbsolutePositioning=False,
    Width=width,
    Height=addition,
    HorizontalAlignment=Slider(2, range=0..10))

launch_window = LaunchWindow(
    Show=Toggle(True),
    Name="Test Interface",
    Width=Slider(1000, range=0..1000),
    Height=Slider(822, range=0..2000),
    ChildStatus=0,
    EnableHorizScroll=False)
add_elements = AddElements(Window=launch_window, Elements=create_border, DoVLChecking=True)  # -> AddedElements, ElementNames

flatten_tree = FlattenTree(Tree=merge_19, Path="{0}")
merge_22 = Merge(Data1=merge_19)  # -> graft(Result)
merge_23 = Merge(Data1=Slider(300, range=0..1000), Data2=Slider(500, range=0..1000), Data3=Slider(1000, range=0..1000))
list_item = ListItem(List=merge_23, Index=value_listener_8.Indices, Wrap=True)
graft_tree = GraftTree(Tree=merge_5, IncludeEmptyLists=True, IncludeNullItems=True)
panel_4 = Panel("bone length")
panel_5 = Panel(merge_19)
param_viewer = ParamViewer(merge_19)
relay = Relay()
data = Data()
panel_6 = Panel(merge_5)
ghpython_script = GhPythonScript(
    x=value_listener.Values,
    t=value_listener_2.Values,
    y=value_listener_9.Indices,
    z=value_listener_10.Indices,
    u=merge_5,
    v=merge_19,
    w=merge_20,
    s=merge_21)  # -> a; inputs u: list, v: list, w: list, s: list
# ---------- ghpython_script: Python ----------
__author__ = "P1"
__version__ = "2023.11.08"

import rhinoscriptsyntax as rs
import json

def setup():
    host = "localhost"
    port = 800
    address = (host, port)

    soc = socket.socket(socket.AF_INET, socket.SOCK_STREAM)
    soc.connect(address)
    
    return soc

def csend(mes, soc):
    soc.send(bytes(mes, encoding="utf8"))
    try:
        buf = soc.recv(4096)
        return buf.decode()
    except err:
        print ("Error receiving :", err)
        return "Error!"
        #sys.exit(1) # 终止程序用

params = {
    'steps': 1000,
    'skel_type': 0,
    'drive_type': 0, 
    'driver_radius': 25.0,
    'driver_offset': [25.0, 25.0],
    'bone_tail': 25.0,
    'base_r': 20.0,
    'slave_r': 20.0,
    'spring_c': 3,
    'spring_w': 12.0,
    'spring_g': 8.0,
    'bone_lengths': [50,50,50,50,50,50,50,50],
    'bend_limits': [90,90,90,90,90,90,90,90],
    'stretch_limits': [0,0,0,0,0,0,0,0]
}

if x is True:
    x = False
    import socket
    import sys
    
    soc = setup()
    
    params['steps'] = t
    
    params['skel_type'] = y
    params['drive_type'] = z
    
    params['driver_radius'] = u[0]
    params['driver_offset'] = [u[1], u[2]]
    params['base_r'] = u[3] / 2.0
    params['slave_r'] = u[3] / 2.0
    params['spring_c'] = u[4]
    
    params['bone_length'] = v
    params['bend_limits'] = w
    params['stretch_limits'] = s

    a= csend(str(params), soc)
    f = open('result.json', 'w')
    f.write(a)
    f.close()
    
    soc.shutdown(socket.SHUT_WR)
    soc.close()
else:
#    print('Invalid')
    a = None
# ---------- end ghpython_script ----------
ghpython_script_2 = GhPythonScript(x=ghpython_script)  # -> bt, st, dp, dr
# ---------- ghpython_script_2: Python ----------
__author__ = "P1"
__version__ = "2023.11.09"

import rhinoscriptsyntax as rs
import json

f = open('result.json', 'r')
res = f.read()
res = json.loads(res)
bt = res['base_spring_t']
st = res['slave_spring_t']
dp = res['driver_phase']
dr = res['driver_radius']
# ---------- end ghpython_script_2 ----------
panel_7 = Panel(ghpython_script_2.bt)
data_output = DataOutput(
    DataInput=ghpython_script,
    Destination="D:\AI\srtp\grasshopper\resdata.ghdata",
    RelativePath="D:\AI\srtp\grasshopper\resdata.ghdata|resdata.ghdata")
